# Dynamo graph ootbPinAllBasicWalls.dyn (Dynamo 2.12.0.5650)

# group: Collect all walls
code_block = CodeBlock { "Walls"; }
byName = Category.ByName(name=code_block)
all_elements_of_category = ElementsOfCategory(Category=byName)

# group: Filter for just basic walls (in)
elementType = Element.ElementType(element=all_elements_of_category)
kind = WallType.Kind(wallType=elementType)
code_block_2 = CodeBlock { "Basic"; }
eq = kind == code_block_2
filterByBoolMask = List.FilterByBoolMask(list=all_elements_of_category, mask=eq)

# group: Pin them!
boolean = BoolSelector(true)
setPinnedStatus = Element.SetPinnedStatus(element=filterByBoolMask.in, pinned=boolean)
