# Dynamo graph pythonPinAllBasicWalls.dyn (Dynamo 2.12.0.5650)

python_script = Python()  # IronPython2; unwired: IN[0]
# ---------- python_script.python (25 lines) ----------
import clr
clr.AddReference("RevitAPI")

from Autodesk.Revit.DB import *

clr.AddReference('RevitServices')
import RevitServices
from RevitServices.Persistence import DocumentManager
from RevitServices.Transactions import TransactionManager

doc = DocumentManager.Instance.CurrentDBDocument

basicWalls = []

allWalls = FilteredElementCollector(doc).OfCategory(BuiltInCategory.OST_Walls).WhereElementIsNotElementType().ToElements()

TransactionManager.Instance.EnsureInTransaction(doc)
for wall in allWalls:
	if wall.WallType.Kind == WallKind.Basic:
		wall.Pinned = True
		basicWalls.append(wall)
TransactionManager.Instance.TransactionTaskDone()

# Assign your output to the OUT variable.
OUT = basicWalls
# ----------------------------------------
